# Grasshopper definition Boat Design WSII 004.gh (Grasshopper 1.0.7)

pt = ConstructPoint(XCoordinate=0, YCoordinate=0, ZCoordinate=0)
# Outer Hull
pt_2 = Point(<point referenced from the Rhino model>)
box = Box2Pt(PointA=pt, PointB=pt_2, Plane=PlaneXY(0, 0, 0))
graph = GraphMapper(
    x0=0,
    x1=1,
    y0=0,
    y1=1,
    container_name="Bezier",
    cpx=[0, 0.7101681232, 0.3330557942, 1],
    cpy=[0, 0.2204506397, 0.7419887781, 1])
crv = Curve(<curve referenced from the Rhino model>)
arrcurve = CurveArray(Geometry=box, Curve=crv, Count=10)  # -> Geometry, Transform
vec = VectorXYZ(XComponent=0, YComponent=0, ZComponent=-10)  # -> Vector, Length
vec_2 = VectorXYZ(XComponent=0, YComponent=0, ZComponent=-20)  # -> Vector, Length
vec_3 = VectorXYZ(XComponent=0, YComponent=0, ZComponent=20)  # -> Vector, Length
vec_4 = VectorXYZ(XComponent=0, YComponent=5, ZComponent=-25)  # -> Vector, Length
vec_5 = VectorXYZ(XComponent=0, YComponent=5, ZComponent=25)  # -> Vector, Length
vec_6 = VectorXYZ(XComponent=0, YComponent=10, ZComponent=-30)  # -> Vector, Length
vec_7 = VectorXYZ(XComponent=0, YComponent=10, ZComponent=30)  # -> Vector, Length
rad = Radians(Degrees="180")
xz = XZPlane(Origin=Point(0, 0, 0))
pt_3 = Point(<point referenced from the Rhino model>)
graph_2 = GraphMapper(
    x0=0,
    x1=1,
    y0=0,
    y1=1,
    container_name="Bezier",
    cpx=[0, 0.6540257335, 0.3330790102, 1],
    cpy=[0, 0.3348380923, 0.6477609873, 1])
rotate = Rotate(Geometry=arrcurve.Geometry, Angle=rad, Plane=xz)  # -> Geometry, Transform
join = BrepJoin(Breps=[rotate.Geometry, arrcurve.Geometry])  # -> Breps, Closed
scale = Scale(Geometry=join.Breps, Center=Point(0, 0, 0), Factor=expr("X*0.9", Slider(1, range=0..1)))  # -> flatten(Geometry), Transform
scale_2 = Scale(Geometry=join.Breps, Center=Point(0, 0, 0), Factor=expr("X*0.9", Slider(0.9, range=0..1)))  # -> flatten(Geometry), Transform
scale_3 = Scale(Geometry=join.Breps, Center=Point(0, 0, 0), Factor=expr("X*0.9", Slider(0.8, range=0..1)))  # -> flatten(Geometry), Transform
scale_4 = Scale(Geometry=join.Breps, Center=Point(0, 0, 0), Factor=expr("X*0.9", Slider(0.7, range=0..1)))  # -> flatten(Geometry), Transform
move = Move(Geometry=scale.Geometry, Motion=Vector(0, 0, 10))  # -> Geometry, Transform
move_2 = Move(Geometry=scale.Geometry, Motion=vec.Vector)  # -> Geometry, Transform
move_3 = Move(Geometry=scale_2.Geometry, Motion=vec_3.Vector)  # -> Geometry, Transform
move_4 = Move(Geometry=scale_2.Geometry, Motion=vec_2.Vector)  # -> Geometry, Transform
move_5 = Move(Geometry=scale_3.Geometry, Motion=vec_5.Vector)  # -> Geometry, Transform
move_6 = Move(Geometry=scale_3.Geometry, Motion=vec_4.Vector)  # -> Geometry, Transform
move_7 = Move(Geometry=scale_4.Geometry, Motion=vec_7.Vector)  # -> Geometry, Transform
move_8 = Move(Geometry=scale_4.Geometry, Motion=vec_6.Vector)  # -> Geometry, Transform
grp = Group([move.Geometry, join.Breps, move_2.Geometry, move_3.Geometry, move_4.Geometry, move_5.Geometry, move_6.Geometry, move_7.Geometry, move_8.Geometry])
xz_2 = XZPlane(Origin=Point(0, 0, 0))

# ---- group: inner
rotate_2 = Rotate(Geometry=grp, Angle=1.570796327, Plane=xz_2)  # -> Geometry, Transform

# ----
# Inner Hull
pt_4 = ConstructPoint(XCoordinate=0, YCoordinate=0, ZCoordinate=0)
box_2 = Box2Pt(PointA=pt_4, PointB=pt_2, Plane=PlaneXY(0, 0, 0))
crv_2 = Curve(<curve referenced from the Rhino model>)
arrcurve_2 = CurveArray(Geometry=box_2, Curve=crv_2, Count=10)  # -> Geometry, Transform
vec_8 = VectorXYZ(XComponent=0, YComponent=0, ZComponent=-10)  # -> Vector, Length
vec_9 = VectorXYZ(XComponent=0, YComponent=0, ZComponent=-20)  # -> Vector, Length
vec_10 = VectorXYZ(XComponent=0, YComponent=0, ZComponent=20)  # -> Vector, Length
vec_11 = VectorXYZ(XComponent=0, YComponent=5, ZComponent=-25)  # -> Vector, Length
vec_12 = VectorXYZ(XComponent=0, YComponent=5, ZComponent=25)  # -> Vector, Length
vec_13 = VectorXYZ(XComponent=0, YComponent=10, ZComponent=-30)  # -> Vector, Length
vec_14 = VectorXYZ(XComponent=0, YComponent=10, ZComponent=30)  # -> Vector, Length
rad_2 = Radians(Degrees="180")
xz_3 = XZPlane(Origin=Point(0, 0, 0))
rotate_3 = Rotate(Geometry=arrcurve_2.Geometry, Angle=rad_2, Plane=xz_3)  # -> Geometry, Transform
join_2 = BrepJoin(Breps=[rotate_3.Geometry, arrcurve_2.Geometry])  # -> Breps, Closed
scale_5 = Scale(Geometry=join_2.Breps, Center=Point(0, 0, 0), Factor=expr("X*0.9", Slider(0.6, range=0..0.6)))  # -> flatten(Geometry), Transform
scale_6 = Scale(Geometry=join_2.Breps, Center=Point(0, 0, 0), Factor=expr("X*0.9", Slider(0.5, range=0..0.5)))  # -> flatten(Geometry), Transform
scale_7 = Scale(Geometry=join_2.Breps, Center=Point(0, 0, 0), Factor=expr("X*0.9", Slider(0.4, range=0..0.4)))  # -> flatten(Geometry), Transform
scale_8 = Scale(Geometry=join_2.Breps, Center=Point(0, 0, 0), Factor=expr("X*0.9", Slider(0.3, range=0..0.3)))  # -> flatten(Geometry), Transform
move_9 = Move(Geometry=scale_5.Geometry, Motion=Vector(0, 0, 10))  # -> Geometry, Transform
move_10 = Move(Geometry=scale_5.Geometry, Motion=vec_8.Vector)  # -> Geometry, Transform
move_11 = Move(Geometry=scale_6.Geometry, Motion=vec_10.Vector)  # -> Geometry, Transform
move_12 = Move(Geometry=scale_6.Geometry, Motion=vec_9.Vector)  # -> Geometry, Transform
move_13 = Move(Geometry=scale_7.Geometry, Motion=vec_12.Vector)  # -> Geometry, Transform
move_14 = Move(Geometry=scale_7.Geometry, Motion=vec_11.Vector)  # -> Geometry, Transform
move_15 = Move(Geometry=scale_8.Geometry, Motion=vec_14.Vector)  # -> Geometry, Transform
move_16 = Move(Geometry=scale_8.Geometry, Motion=vec_13.Vector)  # -> Geometry, Transform

# ---- group: outer
grp_2 = Group([move_9.Geometry, join_2.Breps, move_10.Geometry, move_11.Geometry, move_12.Geometry, move_13.Geometry, move_14.Geometry, move_15.Geometry, move_16.Geometry])

# ----
group = Group(Objects=[rotate_2.Geometry, grp_2])  # disabled
xz_4 = XZPlane(Origin=Point(0, 0, 0))

# ---- group: inner
rotate_4 = Rotate(Geometry=grp_2, Angle=1.570796327, Plane=xz_4)  # -> Geometry, Transform

# ----
group_2 = Group(Objects=[rotate_4.Geometry, grp])
