# Grasshopper definition EvaluateCurve_WSII_2019.gh (Grasshopper 1.0.7)
# plug-ins: Bifocals

point = Point([Point(99, 12.22644091, 0), Point(115.5533737, -137, 0), Point(-22.60981826, -111.0608554, 0), Point(-10.09201583, -0.9974699346, 0)])

# ---- group: 0..4.00 trick
number_slider = Slider(1.57, range=0..4)

# ----
nurbs_curve = NurbsCurve(Vertices=point, Degree=3, Periodic=True)  # -> reparameterize(Curve), Length, Domain
curve = Curve(nurbs_curve.Curve)
domain = Domain(nurbs_curve.Domain)
evaluate_curve = EvaluateCurve(Curve=reparameterize(curve), Parameter=Slider(0.255, range=0..1))  # -> Point, Tangent, Angle
panel = Panel(domain)
number_slider_2 = Slider(111, range=0..200)
construct_domain = ConstructDomain(DomainStart=0, DomainEnd=Slider(631, range=0..1000))
multiplication = Multiplication(A=evaluate_curve.Tangent, B=Slider(80, range=0..100))
range = Range(Domain=Domain(0, 1), Steps=number_slider_2)
point_2 = Point(<point referenced from the Rhino model>)
vector_display = VectorDisplay(Anchor=evaluate_curve.Point, Vector=multiplication)
range_2 = Range(Domain=construct_domain, Steps=number_slider_2)
graph_mapper = GraphMapper(
    range,
    x0=0,
    x1=1,
    y0=0,
    y1=1,
    container_name="Bezier",
    cpx=[0, 0.7707722783, 0.4337781966, 1],
    cpy=[0, 0.3143279552, 0.4587539434, 0.5389906168])
rotate_3d = Rotate3D(Geometry=curve, Angle=expr("-x", degrees(range_2)), Center=point_2, Axis=evaluate_curve.Tangent)  # -> Geometry, Transform
remap = Remap(data=graph_mapper, min=Slider(1, range=0..1), max=Slider(0.01, range=0..0.01))
scale = Scale(Geometry=rotate_3d.Geometry, Center=point_2, Factor=remap)  # -> Geometry, Transform
number = Number([Slider(0.9, range=0.9..1.1), Slider(0.9, range=0.9..1.1), Slider(1.1, range=0.9..1.1), Slider(1.1, range=0.9..1.1)])
repeat_data = RepeatData(Data=number, Length=expr("x+1", number_slider_2))
scale_2 = Scale(Geometry=scale.Geometry, Center=point_2, Factor=repeat_data)  # -> Geometry, Transform
loft = Loft(
    Curves=scale_2.Geometry,
    Options={Adjust=False, Closed=False, LoftEnds=0, LoftSimp=0, LoftType=0, Rebuild=10, Refit=0.01})

# ==== cluster Remap: Remaps numbers
data = ClusterInput()
min = ClusterInput()
max = ClusterInput()
bnd = Bounds(Numbers=data)
dom = ConstructDomain(DomainStart=min, DomainEnd=max)
remap = RemapNumbers(Value=data, Source=bnd, Target=dom)  # -> Mapped, Clipped
R = ClusterOutput(remap.Mapped)
