# Grasshopper definition Graph_Mapper_pipes_WSII_2019.gh (Grasshopper 1.0.7)
# plug-ins: Bifocals

series = Series(Start=Slider(0, range=0..10), Step=Slider(1, range=0..120), Count=Slider(120, range=0..120))
series_2 = Series(Start=Slider(2.5, range=0..10), Step=Slider(7, range=0..10), Count=Slider(5, range=0..10))
series_3 = Series(Start=Slider(2.5, range=0..10), Step=Slider(6, range=0..10), Count=Slider(8, range=0..10))
remap = Remap(data=series, min=0, max=1)
remap_2 = Remap(data=series, min=0, max=1)
cross_reference = CrossReference(ListA=series_2, ListB=series_3, CrossMode=1)  # -> ListA, ListB
graph_mapper = GraphMapper(
    remap,
    x0=0,
    x1=1,
    y0=0,
    y1=1,
    container_name="Bezier",
    cpx=[0, 0.5861033797, 0.5976092815, 1],
    cpy=[0, 0, 0.4997849464, 1])
graph_mapper_2 = GraphMapper(
    remap_2,
    x0=0,
    x1=1,
    y0=0,
    y1=1,
    container_name="Bezier",
    cpx=[0, 0.5861033797, 0.1121161059, 1],
    cpy=[0, 0, 0.6727948189, 1])
construct_point = ConstructPoint(XCoordinate=cross_reference.ListA, YCoordinate=cross_reference.ListB, ZCoordinate=0)
graph_mapper_3 = GraphMapper(graph_mapper, x0=0, x1=1, y0=0, y1=1, container_name="Sine", Equation_px=[0.112153925, 0.2679730356], Equation_py=[0, 1])
graph_mapper_4 = GraphMapper(
    graph_mapper_2,
    x0=0,
    x1=1,
    y0=0,
    y1=1,
    container_name="Sine",
    Equation_px=[0.112153925, 0.5190001726],
    Equation_py=[0, 0.9864096642])
remap_3 = Remap(data=graph_mapper_3, min=Slider(12, range=0..100), max=Slider(100, range=0..100))
remap_4 = Remap(data=graph_mapper_4, min=Slider(12, range=0..100), max=Slider(100, range=0..100))
construct_point_2 = ConstructPoint(XCoordinate=series, YCoordinate=remap_4, ZCoordinate=remap_3)
interpolate = Interpolate(Vertices=construct_point_2, Degree=3, Periodic=False, KnotStyle=1)  # -> Curve, Length, Domain
pipe = Pipe(Curve=interpolate.Curve, Radius=Slider(5, range=0..12), Caps=0)

# ==== cluster Remap: Remaps numbers
data = ClusterInput()
min = ClusterInput()
max = ClusterInput()
bnd = Bounds(Numbers=data)
dom = ConstructDomain(DomainStart=min, DomainEnd=max)
remap = RemapNumbers(Value=data, Source=bnd, Target=dom)  # -> Mapped, Clipped
R = ClusterOutput(remap.Mapped)
