# Grasshopper definition Hamlet's Mill WSII 00 with Bouncy Canopy.gh (Grasshopper 1.0.7)
# plug-ins: Kangaroo2 Components

# ---- group: Window Spheres
# Kangaroo!
number_slider = Slider(24, range=18..24)
sph = Sphere(Base=PlaneXY(0, 0, 0), Radius=Slider(7, range=0..10))
pt = Point(Point(0, 60, 0))
arrpolar = PolarArray(Geometry=sph, Plane=pt, Count=Slider(10, range=0..10), Angle=6.283185307)  # -> graft(Geometry), Transform
Z = UnitZ(Factor=number_slider)
move = Move(Geometry=arrpolar.Geometry, Motion=Z)  # -> flatten(Geometry), Transform

# ----
mplane = MeshPlane(Boundary={Plane=PlaneXY(0, 0, 0), Size=Domain2(u=-10..10, v=-10..10)}, WidthCount=10, HeightCount=10)  # -> Mesh, Area
medges = MeshEdges(Mesh=mplane.Mesh)  # -> NakedEdges, InteriorEdges, NonManifoldEdges
mc = MeshCorners(Mesh=mplane.Mesh, Angle=2.35619449)
len = Length(Curve=medges.NakedEdges)
merge = Merge(Data1=medges.NakedEdges, Data2=medges.InteriorEdges)
anchor = Anchor(Point=mc, Strength=10000)
Z_2 = UnitZ(Factor=1)
demesh = DeconstructMesh(Mesh=mplane.Mesh)  # -> Vertices, Faces, Colours, Normals
multiplication = Multiplication(A=len, B=Slider(1, range=0..1))
grab = Grab(On=True, Strength=1, Range=3)  # -> Grab, Anchors
show = Show(G=mplane.Mesh)
length_line = LengthLine(Line=merge, Length=multiplication, Strength=10)
load = Load(Point=demesh.Vertices, ForceVector=Z_2)
merge_2 = Merge(Data1=length_line, Data2=load, Data3=anchor, Data4=show, Data5=grab.Grab)
bouncysolver = BouncySolver(
    GoalObjects=merge_2,
    Reset=Button(),
    Threshold=1e-15,
    Tolerance=0.01,
    Damping=0.99,
    Iterations=Slider(1, range=1..100),
    On=True)  # -> I, V, O

# ---- group: Door Cut out
rec = Rectangle({Plane=PlaneXY(0, 0, 0), Size=Domain2(u=-4..4, v=-5..5)})
boxrec = BoxRectangle(Rectangle=rec, Height=Slider(25, range=0..100))  # -> flatten(Box)

# ----
geo = Geometry(bouncysolver.O)
Y = UnitY(Factor=Slider(15, range=0..100))
move_2 = Move(Geometry=geo, Motion=Vector(0, 0, 10))  # -> Geometry, Transform
move_3 = Move(Geometry=move_2.Geometry, Motion=Y)  # -> Geometry, Transform

# ---- group: Bricks and rotation/loft arrays
number_slider_2 = Slider(4, range=0..4)
box = CenterBox(Base=PlaneXY(0, 0, 0), X=number_slider_2, Y=expr("x/2", number_slider_2), Z=expr("x/4", number_slider_2))
pt_2 = Point(Point(0, 60, 0))
arrpolar_2 = PolarArray(Geometry=box, Plane=pt_2, Count=Slider(50, range=0..100), Angle=6.283185307)  # -> graft(Geometry), Transform
Z_3 = UnitZ(Factor=Slider(6, range=0..10))
Z_4 = UnitZ(Factor=Slider(4, range=0..10))
Z_5 = UnitZ(Factor=Slider(2, range=0..10))
rad = Radians(Degrees=Slider(2, range=0..2))

# ----
# Boundry Surface Tool!
bvol = BoundaryVolume(Boundaries=arrpolar_2.Geometry)

# ---- group: Bricks and rotation/loft arrays / Even Rows
arrlinear = LinearArray(Geometry=bvol, Direction=Z_4, Count=10)  # -> Geometry, Transform

# ---- group: Bricks and rotation/loft arrays (continued)
arrlinear_2 = LinearArray(Geometry=bvol, Direction=Z_3, Count=10)  # -> Geometry, Transform
move_4 = Move(Geometry=arrlinear.Geometry, Motion=Z_5)  # -> Geometry, Transform

# ----
panel = Panel(arrpolar_2.Geometry)

# ---- group: Bricks and rotation/loft arrays / Odd Rows
rot3d = Rotate3D(Geometry=move_4.Geometry, Angle=rad, Center=pt_2, Axis=Vector(0, 0, 1))  # -> Geometry, Transform

# ----
sunion = SolidUnion(Breps=[rot3d.Geometry, arrlinear.Geometry])
sdiff = SolidDifference(BrepsA=sunion, BrepsB=move.Geometry)  # -> flatten(Result)
panel_2 = Panel(arrlinear.Geometry)
sdiff_2 = SolidDifference(BrepsA=sdiff, BrepsB=boxrec)
panel_3 = Panel(rot3d.Geometry)
scale = Scale(Geometry=sdiff_2, Center=Point(0, 0, 0), Factor=0.25)  # -> Geometry, Transform
