# Grasshopper definition Hamlet's Mill WSII 002.gh (Grasshopper 1.0.7)

# ---- group: Window Spheres
sph = Sphere(Base=PlaneXY(0, 0, 0), Radius=Slider(7, range=0..10))
pt = Point(Point(0, 60, 0))
arrpolar = PolarArray(Geometry=sph, Plane=pt, Count=Slider(10, range=0..10), Angle=6.283185307)  # -> graft(Geometry), Transform
Z = UnitZ(Factor=Slider(24, range=18..24))
move = Move(Geometry=arrpolar.Geometry, Motion=Z)  # -> flatten(Geometry), Transform

# ---- group: Door Cut out
rec = Rectangle({Plane=PlaneXY(0, 0, 0), Size=Domain2(u=-4..4, v=-5..5)})
boxrec = BoxRectangle(Rectangle=rec, Height=Slider(25, range=0..100))  # -> flatten(Box)

# ---- group: Bricks and rotation/loft arrays
number_slider = Slider(4, range=0..4)
box = CenterBox(Base=PlaneXY(0, 0, 0), X=number_slider, Y=expr("x/2", number_slider), Z=expr("x/4", number_slider))
pt_2 = Point(Point(0, 60, 0))
arrpolar_2 = PolarArray(Geometry=box, Plane=pt_2, Count=Slider(50, range=0..100), Angle=6.283185307)  # -> graft(Geometry), Transform
Z_2 = UnitZ(Factor=Slider(6, range=0..10))
Z_3 = UnitZ(Factor=Slider(4, range=0..10))
Z_4 = UnitZ(Factor=Slider(2, range=0..10))
rad = Radians(Degrees=Slider(2, range=0..2))

# ----
# Boundry Surface Tool!
bvol = BoundaryVolume(Boundaries=arrpolar_2.Geometry)

# ---- group: Bricks and rotation/loft arrays / Even Rows
arrlinear = LinearArray(Geometry=bvol, Direction=Z_3, Count=10)  # -> Geometry, Transform

# ---- group: Bricks and rotation/loft arrays (continued)
arrlinear_2 = LinearArray(Geometry=bvol, Direction=Z_2, Count=10)  # -> Geometry, Transform
move_2 = Move(Geometry=arrlinear.Geometry, Motion=Z_4)  # -> Geometry, Transform

# ----
panel = Panel(arrpolar_2.Geometry)

# ---- group: Bricks and rotation/loft arrays / Odd Rows
rot3d = Rotate3D(Geometry=move_2.Geometry, Angle=rad, Center=pt_2, Axis=Vector(0, 0, 1))  # -> Geometry, Transform

# ----
sunion = SolidUnion(Breps=[rot3d.Geometry, arrlinear.Geometry])
sdiff = SolidDifference(BrepsA=sunion, BrepsB=move.Geometry)  # -> flatten(Result)
panel_2 = Panel(arrlinear.Geometry)
panel_3 = Panel(rot3d.Geometry)
sdiff_2 = SolidDifference(BrepsA=sdiff, BrepsB=boxrec)
