# Grasshopper definition Offset Curve and Flatten Tree after grafting it....gh (Grasshopper 1.0.7)

# Data Tree Loft Breakthrough!
# 
# with Off Set Curve Tool
number_slider = Slider(9, range=0..100)
yz = YZPlane(Origin=Point(0, 0, 0))
series = Series(Start=0, Step=number_slider, Count=10)
pt = ConstructPoint(XCoordinate=graft(series), YCoordinate=series, ZCoordinate=0)
intcrv = Interpolate(Vertices=pt, Degree=3, Periodic=False, KnotStyle=1)  # -> flatten(Curve), Length, Domain
offset = OffsetCurve(Curve=intcrv.Curve, Distance=Slider(55, range=0..100), Plane=yz, Corners=1)  # -> flatten(Curve)
flip = FlipMatrix(Data=intcrv.Curve)
flip_2 = FlipMatrix(Data=offset)
loft = Loft(Curves=[flip, flip_2], Options={Adjust=False, Closed=False, LoftEnds=0, LoftSimp=0, LoftType=0, Rebuild=10, Refit=0.01})
viewer = ParamViewer(intcrv.Curve)
viewer_2 = ParamViewer(intcrv.Curve)
panel = Panel(pt)
