# Grasshopper definition Orient_direction_WSII_2019.gh (Grasshopper 1.0.7)

curve = Curve([<curve referenced from the Rhino model> x225])
point = Point(Point(96.29745808, 80.4900009, 0))
area = Area(Geometry=curve)  # -> Area, Centroid
polygon_center = PolygonCenter()  # -> CenterV, CenterE, CenterA
vector_display = VectorDisplay()
vector_2pt = Vector2Pt(PointA=area.Centroid, PointB=point, Unitize=False)  # -> Vector, Length
unit_x = UnitX(Factor=1)
remap = Remap(data=vector_2pt.Length, min=0, max=1)
remap_2 = Remap(data=vector_2pt.Length, min=0, max=1)
graph_mapper = GraphMapper(
    remap_2,
    x0=0,
    x1=1,
    y0=0,
    y1=1,
    container_name="Bezier",
    cpx=[0, 0.1008974686, 0.9432652593, 1],
    cpy=[0, 0.5559245348, 0.6310039759, 1])
unit_vector = UnitVector(Vector=vector_2pt.Vector)
graph_mapper_2 = GraphMapper(remap, x0=0, x1=1, y0=0, y1=1, container_name="Sine", Equation_px=[0, 0.9400278926], Equation_py=[0, 0.8215915561])
unit_vector_2 = UnitVector(Vector=vector_2pt.Vector)
remap_3 = Remap(data=graph_mapper, min=Slider(1.6, range=0..10), max=Slider(0.2, range=0..1))
multiplication = Multiplication(A=unit_vector, B=remap_3)
remap_4 = Remap(data=graph_mapper_2, min=Slider(0.2, range=0..1), max=Slider(98.8, range=0..400))
multiplication_2 = Multiplication(A=unit_vector_2, B=remap_4)
move = Move(Geometry=area.Centroid, Motion=expr("-x", multiplication_2))  # -> Geometry, Transform
orient_direction = OrientDirection(Geometry=curve, PointA=area.Centroid, DirectionA=unit_x, PointB=move.Geometry, DirectionB=multiplication)  # -> Geometry, Transform

# ==== cluster Remap: Remaps numbers
data = ClusterInput()
min = ClusterInput()
max = ClusterInput()
bnd = Bounds(Numbers=data)
dom = ConstructDomain(DomainStart=min, DomainEnd=max)
remap = RemapNumbers(Value=data, Source=bnd, Target=dom)  # -> Mapped, Clipped
R = ClusterOutput(remap.Mapped)
