# Grasshopper definition Other Expressions and Functions.gh (Grasshopper 1.0.7)

# Single Phase Cos Curve
number_slider = Slider(4, range=0..100)
# Single Phase Tanh Curve  (ship Hull)
number_slider_2 = Slider(23, range=0..100)
# Single Phase Sine Curve
number_slider_3 = Slider(4, range=0..100)
pi = Pi(Factor=number_slider_2)
pi_2 = Pi(Factor=number_slider)
pi_3 = Pi(Factor=number_slider_3)
dom = ConstructDomain(DomainStart=0, DomainEnd=pi)
dom_2 = ConstructDomain(DomainStart=0, DomainEnd=pi_2)
dom_3 = ConstructDomain(DomainStart=0, DomainEnd=pi_3)
number_slider_4 = Slider(1, range=0..2)
pi_4 = Pi(Factor=Slider(0, range=0..4))
pi_5 = Pi(Factor=Slider(0, range=0..4))
pi_6 = Pi(Factor=Slider(0, range=0..4))
range = Range(Domain=dom, Steps=Slider(128, range=0..128))
range_2 = Range(Domain=dom_2, Steps=Slider(128, range=0..128))
range_3 = Range(Domain=dom_3, Steps=Slider(128, range=0..128))
expression = Expression(A=Slider(5, range=0..10), t=range_2, x=pi_5, w=Slider(1, range=0..2), Expression="A*cos(w*t+x)")
expression_2 = Expression(A=Slider(5, range=0..10), t=range_3, x=pi_6, w=Slider(1, range=0..2), Expression="A*sin(w*t+x)")
expression_3 = Expression(A=Slider(4, range=0..10), t=range, x=pi_4, w=number_slider_4, Expression="A*sin(w*t+x)")
expression_4 = Expression(A=Slider(7, range=0..30), t=range, x=pi_4, w=number_slider_4, Expression="A*cos(x*t+t)")
pt = ConstructPoint(XCoordinate=range, YCoordinate=Slider(0, range=0..10), ZCoordinate=expression_3)
pt_2 = ConstructPoint(XCoordinate=range, YCoordinate=Slider(0, range=0..100), ZCoordinate=expression_4)
pt_3 = ConstructPoint(XCoordinate=range_2, YCoordinate=Slider(6, range=0..10), ZCoordinate=expression)
pt_4 = ConstructPoint(XCoordinate=range_3, YCoordinate=Slider(6, range=0..10), ZCoordinate=expression_2)
intcrv = Interpolate(Vertices=pt, Degree=3, Periodic=False, KnotStyle=1)  # -> Curve, Length, Domain
intcrv_2 = Interpolate(Vertices=pt_2, Degree=3, Periodic=False, KnotStyle=1)  # -> Curve, Length, Domain
intcrv_3 = Interpolate(Vertices=pt_3, Degree=3, Periodic=False, KnotStyle=1)  # -> Curve, Length, Domain
intcrv_4 = Interpolate(Vertices=pt_4, Degree=3, Periodic=False, KnotStyle=1)  # -> Curve, Length, Domain
xz = XZPlane(Origin=Point(0, 0, 0))
arrpolar = PolarArray(Geometry=intcrv.Curve, Plane=xz, Count=10, Angle=6.283185307)  # -> Geometry, Transform
Z = UnitZ(Factor=Slider(19, range=0..100))
xz_2 = XZPlane(Origin=Point(0, 0, 0))
extr = Extrude(Base=intcrv_2.Curve, Direction=Z)
Y = UnitY(Factor=Slider(21, range=0..100))
arrpolar_2 = PolarArray(Geometry=extr, Plane=xz_2, Count=10, Angle=6.283185307)  # -> Geometry, Transform
extr_2 = Extrude(Base=arrpolar_2.Geometry, Direction=Y)
brep = Brep(extr_2)
group = Group(Objects=brep)
