# Grasshopper definition Parametric Tri wheel WSII.gh (Grasshopper 1.0.7)

number_slider = Slider(10, range=2..10)
number_slider_2 = Slider(0.556, range=0.5..1)
number_slider_3 = Slider(9, range=0..19)
number_slider_4 = Slider(0.5, range=0.5..1)
number_slider_5 = Slider(0.5, range=0.5..1)
number_slider_6 = Slider(1, range=0..1)
number_slider_7 = Slider(10, range=2..10)
number_slider_8 = Slider(0.556, range=0.5..1)
number_slider_9 = Slider(8, range=0..19)
number_slider_10 = Slider(0.5, range=0.5..1)
number_slider_11 = Slider(10, range=2..10)
number_slider_12 = Slider(0.556, range=0.5..1)
number_slider_13 = Slider(0.5, range=0.5..1)
number_slider_14 = Slider(7, range=0..19)
number_slider_15 = Slider(10, range=2..10)
number_slider_16 = Slider(0.5, range=0.5..1)
number_slider_17 = Slider(0.5, range=0.5..1)
number_slider_18 = Slider(6, range=0..19)
number_slider_19 = Slider(0.5, range=0.5..1)
number_slider_20 = Slider(0.5, range=0.5..1)
number_slider_21 = Slider(10, range=0..10)
number_slider_22 = Slider(1, range=0..1)
number_slider_23 = Slider(0.5, range=0.5..1)
number_slider_24 = Slider(0.5, range=0.5..1)
number_slider_25 = Slider(5, range=0..19)
number_slider_26 = Slider(0.5, range=0.5..1)
number_slider_27 = Slider(1, range=0..1)
number_slider_28 = Slider(1, range=0..2)
number_slider_29 = Slider(1, range=0..1)
number_slider_30 = Slider(24, range=0..24)
number_slider_31 = Slider(0.5, range=0.5..1)
number_slider_32 = Slider(24, range=0..24)
number_slider_33 = Slider(24, range=0..24)
number_slider_34 = Slider(24, range=0..24)
number_slider_35 = Slider(24, range=0..24)
expression = Expression(x=number_slider_3, Expression="x+1")
expression_2 = Expression(x=number_slider_3, Expression="x+1")
expression_3 = Expression(x=number_slider_9, Expression="x+1")
polygon = Polygon(Plane=PlaneXY(0, 0, 0), Radius=Slider(60, range=0..60), Segments=number_slider, FilletRadius=0)  # -> Polygon, Length
expression_4 = Expression(x=number_slider_14, Expression="x+1")
expression_5 = Expression(x=number_slider_9, Expression="x+1")
expression_6 = Expression(x=number_slider_18, Expression="x+1")
expression_7 = Expression(x=number_slider_14, Expression="x+1")
expression_8 = Expression(x=number_slider_18, Expression="x+1")
expression_9 = Expression(x=number_slider_25, Expression="x+1")
polygon_2 = Polygon(Plane=PlaneXY(0, 0, 0), Radius=Slider(60, range=0..60), Segments=number_slider_7, FilletRadius=0)  # -> Polygon, Length
expression_10 = Expression(x=number_slider_25, Expression="x+1")
polygon_3 = Polygon(Plane=PlaneXY(0, 0, 0), Radius=Slider(60, range=0..60), Segments=number_slider_11, FilletRadius=0)  # -> Polygon, Length
polygon_4 = Polygon(Plane=PlaneXY(0, 0, 0), Radius=Slider(60, range=0..60), Segments=number_slider_15, FilletRadius=0)  # -> Polygon, Length
polygon_5 = Polygon(Plane=PlaneXY(0, 0, 0), Radius=Slider(60, range=0..60), Segments=number_slider_21, FilletRadius=0)  # -> Polygon, Length
divide = DivideCurve(Curve=polygon.Polygon, Count=number_slider, Kinks=False)  # -> Points, Tangents, Parameters
item = ListItem(List=divide.Points, Index=number_slider_3, Wrap=True)
item_2 = ListItem(List=divide.Points, Index=expression, Wrap=True)
divide_2 = DivideCurve(Curve=polygon_2.Polygon, Count=number_slider_7, Kinks=False)  # -> Points, Tangents, Parameters
item_3 = ListItem(List=divide_2.Points, Index=number_slider_9, Wrap=True)
item_4 = ListItem(List=divide_2.Points, Index=expression_3, Wrap=True)
divide_3 = DivideCurve(Curve=polygon_3.Polygon, Count=number_slider_11, Kinks=False)  # -> Points, Tangents, Parameters
item_5 = ListItem(List=divide_3.Points, Index=number_slider_14, Wrap=True)
item_6 = ListItem(List=divide_3.Points, Index=expression_4, Wrap=True)
divide_4 = DivideCurve(Curve=polygon_4.Polygon, Count=number_slider_15, Kinks=False)  # -> Points, Tangents, Parameters
item_7 = ListItem(List=divide_4.Points, Index=number_slider_18, Wrap=True)
item_8 = ListItem(List=divide_4.Points, Index=expression_6, Wrap=True)
divide_5 = DivideCurve(Curve=polygon_5.Polygon, Count=number_slider_21, Kinks=False)  # -> Points, Tangents, Parameters
item_9 = ListItem(List=divide_5.Points, Index=number_slider_25, Wrap=True)
item_10 = ListItem(List=divide_5.Points, Index=expression_9, Wrap=True)
ln = Line(StartPoint=item, EndPoint=item_2)
ln_2 = Line(StartPoint=item_3, EndPoint=item_4)
ln_3 = Line(StartPoint=item_5, EndPoint=item_6)

# ---- group: CENTER
avr = Average(Input=divide.Points)

# ----
ln_4 = Line(StartPoint=divide.Points, EndPoint=avr)
item_11 = ListItem(List=ln_4, Index=number_slider_3, Wrap=True)
item_12 = ListItem(List=ln_4, Index=expression_2, Wrap=True)
ln_5 = Line(StartPoint=item_7, EndPoint=item_8)
ln_6 = Line(StartPoint=item_9, EndPoint=item_10)

# ---- group: CENTER
avr_2 = Average(Input=divide_2.Points)

# ----
ln_7 = Line(StartPoint=divide_2.Points, EndPoint=avr_2)
item_13 = ListItem(List=ln_7, Index=number_slider_9, Wrap=True)
item_14 = ListItem(List=ln_7, Index=expression_5, Wrap=True)

# ---- group: CENTER
avr_3 = Average(Input=divide_3.Points)

# ----
ln_8 = Line(StartPoint=divide_3.Points, EndPoint=avr_3)
item_15 = ListItem(List=ln_8, Index=number_slider_14, Wrap=True)
item_16 = ListItem(List=ln_8, Index=expression_7, Wrap=True)

# ---- group: CENTER
avr_4 = Average(Input=divide_4.Points)

# ----
ln_9 = Line(StartPoint=divide_4.Points, EndPoint=avr_4)
item_17 = ListItem(List=ln_9, Index=number_slider_18, Wrap=True)
item_18 = ListItem(List=ln_9, Index=expression_8, Wrap=True)

# ---- group: CENTER
avr_5 = Average(Input=divide_5.Points)

# ----
ln_10 = Line(StartPoint=divide_5.Points, EndPoint=avr_5)
item_19 = ListItem(List=ln_10, Index=number_slider_25, Wrap=True)
item_20 = ListItem(List=ln_10, Index=expression_10, Wrap=True)
divide_6 = DivideCurve(Curve=item_11, Count=Slider(1, range=0..2), Kinks=False)  # -> Points, Tangents, Parameters
divide_7 = DivideCurve(Curve=ln, Count=Slider(2, range=0..2), Kinks=False)  # -> Points, Tangents, Parameters
divide_8 = DivideCurve(Curve=item_12, Count=Slider(2, range=0..2), Kinks=False)  # -> Points, Tangents, Parameters
divide_9 = DivideCurve(Curve=item_13, Count=Slider(0, range=0..2), Kinks=False)  # -> Points, Tangents, Parameters
divide_10 = DivideCurve(Curve=ln_2, Count=Slider(2, range=0..2), Kinks=False)  # -> Points, Tangents, Parameters
divide_11 = DivideCurve(Curve=item_14, Count=Slider(2, range=0..2), Kinks=False)  # -> Points, Tangents, Parameters
divide_12 = DivideCurve(Curve=item_15, Count=Slider(2, range=0..2), Kinks=False)  # -> Points, Tangents, Parameters
divide_13 = DivideCurve(Curve=ln_3, Count=Slider(2, range=0..2), Kinks=False)  # -> Points, Tangents, Parameters
divide_14 = DivideCurve(Curve=item_17, Count=Slider(2, range=0..2), Kinks=False)  # -> Points, Tangents, Parameters
divide_15 = DivideCurve(Curve=ln_5, Count=Slider(2, range=0..2), Kinks=False)  # -> Points, Tangents, Parameters
divide_16 = DivideCurve(Curve=item_16, Count=Slider(2, range=0..2), Kinks=False)  # -> Points, Tangents, Parameters
divide_17 = DivideCurve(Curve=item_18, Count=Slider(2, range=0..2), Kinks=False)  # -> Points, Tangents, Parameters
divide_18 = DivideCurve(Curve=item_19, Count=Slider(2, range=0..2), Kinks=False)  # -> Points, Tangents, Parameters
divide_19 = DivideCurve(Curve=ln_6, Count=Slider(2, range=0..2), Kinks=False)  # -> Points, Tangents, Parameters
divide_20 = DivideCurve(Curve=item_20, Count=Slider(2, range=0..2), Kinks=False)  # -> Points, Tangents, Parameters
item_21 = ListItem(List=divide_6.Points, Index=number_slider_6, Wrap=True)
item_22 = ListItem(List=divide_7.Points, Index=number_slider_6, Wrap=True)
item_23 = ListItem(List=divide_8.Points, Index=number_slider_6, Wrap=True)
item_24 = ListItem(List=divide_9.Points, Index=number_slider_22, Wrap=True)
item_25 = ListItem(List=divide_10.Points, Index=number_slider_22, Wrap=True)
item_26 = ListItem(List=divide_12.Points, Index=number_slider_27, Wrap=True)
item_27 = ListItem(List=divide_13.Points, Index=number_slider_27, Wrap=True)
item_28 = ListItem(List=divide_14.Points, Index=number_slider_29, Wrap=True)
item_29 = ListItem(List=divide_11.Points, Index=number_slider_22, Wrap=True)
item_30 = ListItem(List=divide_15.Points, Index=number_slider_29, Wrap=True)
item_31 = ListItem(List=divide_16.Points, Index=number_slider_27, Wrap=True)
item_32 = ListItem(List=divide_18.Points, Index=number_slider_28, Wrap=True)
item_33 = ListItem(List=divide_17.Points, Index=number_slider_29, Wrap=True)
item_34 = ListItem(List=divide_19.Points, Index=number_slider_28, Wrap=True)
item_35 = ListItem(List=divide_20.Points, Index=number_slider_28, Wrap=True)
ln_11 = Line(StartPoint=avr, EndPoint=item_22)
scale = Scale(Geometry=ln_11, Center=item_22, Factor=number_slider_4)  # -> Geometry, Transform
ln_12 = Line(StartPoint=avr_2, EndPoint=item_25)
ln_13 = Line(StartPoint=avr_3, EndPoint=item_27)
ln_14 = Line(StartPoint=avr_4, EndPoint=item_30)
scale_2 = Scale(Geometry=ln_12, Center=item_25, Factor=number_slider_10)  # -> Geometry, Transform
ln_15 = Line(StartPoint=avr_5, EndPoint=item_34)
scale_3 = Scale(Geometry=ln_13, Center=item_27, Factor=number_slider_16)  # -> Geometry, Transform
scale_4 = Scale(Geometry=ln_14, Center=item_30, Factor=number_slider_19)  # -> Geometry, Transform
scale_5 = Scale(Geometry=ln_15, Center=item_34, Factor=number_slider_26)  # -> Geometry, Transform
divide_21 = DivideCurve(Curve=scale.Geometry, Count=number_slider_4, Kinks=False)  # -> Points, Tangents, Parameters
divide_22 = DivideCurve(Curve=scale_2.Geometry, Count=number_slider_10, Kinks=False)  # -> Points, Tangents, Parameters
divide_23 = DivideCurve(Curve=scale_3.Geometry, Count=number_slider_16, Kinks=False)  # -> Points, Tangents, Parameters
divide_24 = DivideCurve(Curve=scale_4.Geometry, Count=number_slider_19, Kinks=False)  # -> Points, Tangents, Parameters
divide_25 = DivideCurve(Curve=scale_5.Geometry, Count=number_slider_26, Kinks=False)  # -> Points, Tangents, Parameters
item_36 = ListItem(List=divide_21.Points, Index=Slider(0, range=0..1), Wrap=True)
ln_16 = Line(StartPoint=item_36, EndPoint=item_21)
scale_6 = Scale(Geometry=ln_16, Center=item_21, Factor=number_slider_2)  # -> Geometry, Transform
divide_26 = DivideCurve(Curve=scale_6.Geometry, Count=number_slider_2, Kinks=False)  # -> Points, Tangents, Parameters
ln_17 = Line(StartPoint=item_36, EndPoint=item_23)
scale_7 = Scale(Geometry=ln_17, Center=item_23, Factor=number_slider_5)  # -> Geometry, Transform
divide_27 = DivideCurve(Curve=scale_7.Geometry, Count=number_slider_5, Kinks=False)  # -> Points, Tangents, Parameters
item_37 = ListItem(List=divide_27.Points, Index=Slider(0, range=0..1), Wrap=True)
item_38 = ListItem(List=divide_26.Points, Index=Slider(0, range=0..1), Wrap=True)
item_39 = ListItem(List=divide_22.Points, Index=Slider(0, range=0..1), Wrap=True)
ln_18 = Line(StartPoint=item_39, EndPoint=item_24)
scale_8 = Scale(Geometry=ln_18, Center=item_24, Factor=number_slider_8)  # -> Geometry, Transform
divide_28 = DivideCurve(Curve=scale_8.Geometry, Count=number_slider_8, Kinks=False)  # -> Points, Tangents, Parameters
ln_19 = Line(StartPoint=item_39, EndPoint=item_29)
scale_9 = Scale(Geometry=ln_19, Center=item_29, Factor=number_slider_13)  # -> Geometry, Transform
divide_29 = DivideCurve(Curve=scale_9.Geometry, Count=number_slider_13, Kinks=False)  # -> Points, Tangents, Parameters
item_40 = ListItem(List=divide_29.Points, Index=Slider(0, range=0..1), Wrap=True)
item_41 = ListItem(List=divide_23.Points, Index=Slider(0, range=0..1), Wrap=True)
ln_20 = Line(StartPoint=item_41, EndPoint=item_26)
scale_10 = Scale(Geometry=ln_20, Center=item_26, Factor=number_slider_12)  # -> Geometry, Transform
divide_30 = DivideCurve(Curve=scale_10.Geometry, Count=number_slider_12, Kinks=False)  # -> Points, Tangents, Parameters
ln_21 = Line(StartPoint=item_41, EndPoint=item_31)
scale_11 = Scale(Geometry=ln_21, Center=item_31, Factor=number_slider_20)  # -> Geometry, Transform
divide_31 = DivideCurve(Curve=scale_11.Geometry, Count=number_slider_20, Kinks=False)  # -> Points, Tangents, Parameters
item_42 = ListItem(List=divide_28.Points, Index=Slider(0, range=0..1), Wrap=True)
item_43 = ListItem(List=divide_24.Points, Index=Slider(0, range=0..1), Wrap=True)
ln_22 = Line(StartPoint=item_43, EndPoint=item_28)
scale_12 = Scale(Geometry=ln_22, Center=item_28, Factor=number_slider_17)  # -> Geometry, Transform
divide_32 = DivideCurve(Curve=scale_12.Geometry, Count=number_slider_17, Kinks=False)  # -> Points, Tangents, Parameters
ln_23 = Line(StartPoint=item_43, EndPoint=item_33)
scale_13 = Scale(Geometry=ln_23, Center=item_33, Factor=number_slider_23)  # -> Geometry, Transform
divide_33 = DivideCurve(Curve=scale_13.Geometry, Count=number_slider_23, Kinks=False)  # -> Points, Tangents, Parameters
item_44 = ListItem(List=divide_31.Points, Index=Slider(0, range=0..1), Wrap=True)
item_45 = ListItem(List=divide_30.Points, Index=Slider(0, range=0..1), Wrap=True)
item_46 = ListItem(List=divide_33.Points, Index=Slider(0, range=0..1), Wrap=True)
item_47 = ListItem(List=divide_32.Points, Index=Slider(0, range=0..1), Wrap=True)
item_48 = ListItem(List=divide_25.Points, Index=Slider(0, range=0..1), Wrap=True)
ln_24 = Line(StartPoint=item_48, EndPoint=item_32)
scale_14 = Scale(Geometry=ln_24, Center=item_32, Factor=number_slider_24)  # -> Geometry, Transform
divide_34 = DivideCurve(Curve=scale_14.Geometry, Count=number_slider_24, Kinks=False)  # -> Points, Tangents, Parameters
ln_25 = Line(StartPoint=item_48, EndPoint=item_35)
scale_15 = Scale(Geometry=ln_25, Center=item_35, Factor=number_slider_31)  # -> Geometry, Transform
divide_35 = DivideCurve(Curve=scale_15.Geometry, Count=number_slider_31, Kinks=False)  # -> Points, Tangents, Parameters
item_49 = ListItem(List=divide_35.Points, Index=Slider(0, range=0..1), Wrap=True)
item_50 = ListItem(List=divide_34.Points, Index=Slider(0, range=0..1), Wrap=True)
srf4pt = _4PointSurface(CornerA=avr, CornerB=item, CornerC=item_38)
srf4pt_2 = _4PointSurface(CornerA=avr, CornerB=item_2, CornerC=item_37)
srf4pt_3 = _4PointSurface(CornerA=item, CornerB=item_2, CornerC=item_36)
srf4pt_4 = _4PointSurface(CornerA=avr_2, CornerB=item_3, CornerC=item_42)
srf4pt_5 = _4PointSurface(CornerA=avr_2, CornerB=item_4, CornerC=item_40)
srf4pt_6 = _4PointSurface(CornerA=item_3, CornerB=item_4, CornerC=item_39)
srf4pt_7 = _4PointSurface(CornerA=avr_3, CornerB=item_5, CornerC=item_45)
srf4pt_8 = _4PointSurface(CornerA=avr_4, CornerB=item_7, CornerC=item_47)
srf4pt_9 = _4PointSurface(CornerA=avr_3, CornerB=item_6, CornerC=item_44)
srf4pt_10 = _4PointSurface(CornerA=item_5, CornerB=item_6, CornerC=item_41)
srf4pt_11 = _4PointSurface(CornerA=avr_4, CornerB=item_8, CornerC=item_46)
srf4pt_12 = _4PointSurface(CornerA=item_7, CornerB=item_8, CornerC=item_43)
srf4pt_13 = _4PointSurface(CornerA=avr_5, CornerB=item_9, CornerC=item_50)
srf4pt_14 = _4PointSurface(CornerA=avr_5, CornerB=item_10, CornerC=item_49)
srf4pt_15 = _4PointSurface(CornerA=item_9, CornerB=item_10, CornerC=item_48)
random = Random(Range=number_slider_30, Number=1, Seed=Slider(0, range=0..10))
Z = UnitZ(Factor=random)
random_2 = Random(Range=number_slider_30, Number=1, Seed=Slider(4, range=0..10))
random_3 = Random(Range=number_slider_30, Number=1, Seed=Slider(6, range=0..10))
Z_2 = UnitZ(Factor=random_3)
Z_3 = UnitZ(Factor=random_2)
random_4 = Random(Range=number_slider_32, Number=1, Seed=Slider(0, range=0..10))
Z_4 = UnitZ(Factor=random_4)
random_5 = Random(Range=number_slider_32, Number=1, Seed=Slider(4, range=0..10))
random_6 = Random(Range=number_slider_32, Number=1, Seed=Slider(6, range=0..10))
random_7 = Random(Range=number_slider_33, Number=1, Seed=Slider(0, range=0..10))
Z_5 = UnitZ(Factor=random_7)
random_8 = Random(Range=number_slider_33, Number=1, Seed=Slider(4, range=0..10))
random_9 = Random(Range=number_slider_34, Number=1, Seed=Slider(5, range=0..10))
Z_6 = UnitZ(Factor=random_9)
Z_7 = UnitZ(Factor=random_6)
random_10 = Random(Range=number_slider_33, Number=1, Seed=Slider(6, range=0..10))
random_11 = Random(Range=number_slider_34, Number=1, Seed=Slider(9, range=0..10))
random_12 = Random(Range=number_slider_34, Number=1, Seed=Slider(4, range=0..10))
Z_8 = UnitZ(Factor=random_5)
Z_9 = UnitZ(Factor=random_10)
random_13 = Random(Range=number_slider_35, Number=1, Seed=Slider(0, range=0..10))
Z_10 = UnitZ(Factor=random_13)
Z_11 = UnitZ(Factor=random_12)
random_14 = Random(Range=number_slider_35, Number=1, Seed=Slider(4, range=0..10))
Z_12 = UnitZ(Factor=random_8)
random_15 = Random(Range=number_slider_35, Number=1, Seed=Slider(6, range=0..10))
Z_13 = UnitZ(Factor=random_11)
Z_14 = UnitZ(Factor=random_15)
Z_15 = UnitZ(Factor=random_14)
extr = Extrude(Base=srf4pt_3, Direction=Z_2)
extr_2 = Extrude(Base=srf4pt_2, Direction=Z)
extr_3 = Extrude(Base=srf4pt, Direction=Z_3)
extr_4 = Extrude(Base=srf4pt_6, Direction=Z_7)
extr_5 = Extrude(Base=srf4pt_5, Direction=Z_4)
extr_6 = Extrude(Base=srf4pt_4, Direction=Z_8)
extr_7 = Extrude(Base=srf4pt_10, Direction=Z_9)
extr_8 = Extrude(Base=srf4pt_9, Direction=Z_5)
extr_9 = Extrude(Base=srf4pt_7, Direction=Z_12)
extr_10 = Extrude(Base=srf4pt_12, Direction=Z_11)
extr_11 = Extrude(Base=srf4pt_11, Direction=Z_6)
extr_12 = Extrude(Base=srf4pt_8, Direction=Z_13)
extr_13 = Extrude(Base=srf4pt_15, Direction=Z_14)
extr_14 = Extrude(Base=srf4pt_14, Direction=Z_10)
extr_15 = Extrude(Base=srf4pt_13, Direction=Z_15)
group = Group(Objects=[extr_13, extr_14, extr_15])
group_2 = Group(Objects=[extr_10, extr_11, extr_12])
group_3 = Group(Objects=[extr, extr_2, extr_3])
group_4 = Group(Objects=[extr_7, extr_8, extr_9])
group_5 = Group(Objects=[extr_4, extr_5, extr_6])
number_slider_36 = Slider(10, range=2..10)
number_slider_37 = Slider(0.556, range=0.5..1)
number_slider_38 = Slider(14, range=0..19)
number_slider_39 = Slider(0.5, range=0.5..1)
number_slider_40 = Slider(0.5, range=0.5..1)
number_slider_41 = Slider(1, range=0..1)
number_slider_42 = Slider(10, range=2..10)
number_slider_43 = Slider(0.556, range=0.5..1)
number_slider_44 = Slider(13, range=0..19)
number_slider_45 = Slider(0.5, range=0.5..1)
number_slider_46 = Slider(10, range=2..10)
number_slider_47 = Slider(0.556, range=0.5..1)
number_slider_48 = Slider(0.5, range=0.5..1)
number_slider_49 = Slider(12, range=0..19)
number_slider_50 = Slider(10, range=2..10)
number_slider_51 = Slider(0.5, range=0.5..1)
number_slider_52 = Slider(0.556, range=0.5..1)
number_slider_53 = Slider(11, range=0..19)
number_slider_54 = Slider(0.5, range=0.5..1)
number_slider_55 = Slider(0.5, range=0.5..1)
number_slider_56 = Slider(1, range=0..1)
number_slider_57 = Slider(0.5, range=0.5..1)
number_slider_58 = Slider(10, range=2..10)
number_slider_59 = Slider(0.556, range=0.5..1)
number_slider_60 = Slider(10, range=0..19)
number_slider_61 = Slider(0.5, range=0.5..1)
number_slider_62 = Slider(1, range=0..1)
number_slider_63 = Slider(1, range=0..1)
number_slider_64 = Slider(24, range=0..24)
number_slider_65 = Slider(0.5, range=0.5..1)
number_slider_66 = Slider(1, range=0..1)
number_slider_67 = Slider(24, range=0..24)
number_slider_68 = Slider(24, range=0..24)
number_slider_69 = Slider(24, range=0..24)
number_slider_70 = Slider(24, range=0..24)
expression_11 = Expression(x=number_slider_38, Expression="x+1")
expression_12 = Expression(x=number_slider_38, Expression="x+1")
expression_13 = Expression(x=number_slider_44, Expression="x+1")
polygon_6 = Polygon(Plane=PlaneXY(0, 0, 0), Radius=Slider(60, range=0..60), Segments=number_slider_36, FilletRadius=0)  # -> Polygon, Length
expression_14 = Expression(x=number_slider_49, Expression="x+1")
expression_15 = Expression(x=number_slider_44, Expression="x+1")
expression_16 = Expression(x=number_slider_53, Expression="x+1")
expression_17 = Expression(x=number_slider_49, Expression="x+1")
expression_18 = Expression(x=number_slider_53, Expression="x+1")
expression_19 = Expression(x=number_slider_60, Expression="x+1")
polygon_7 = Polygon(Plane=PlaneXY(0, 0, 0), Radius=Slider(60, range=0..60), Segments=number_slider_42, FilletRadius=0)  # -> Polygon, Length
expression_20 = Expression(x=number_slider_60, Expression="x+1")
polygon_8 = Polygon(Plane=PlaneXY(0, 0, 0), Radius=Slider(60, range=0..60), Segments=number_slider_46, FilletRadius=0)  # -> Polygon, Length
polygon_9 = Polygon(Plane=PlaneXY(0, 0, 0), Radius=Slider(60, range=0..60), Segments=number_slider_50, FilletRadius=0)  # -> Polygon, Length
polygon_10 = Polygon(Plane=PlaneXY(0, 0, 0), Radius=Slider(60, range=0..60), Segments=number_slider_58, FilletRadius=0)  # -> Polygon, Length
divide_36 = DivideCurve(Curve=polygon_6.Polygon, Count=number_slider_36, Kinks=False)  # -> Points, Tangents, Parameters
item_51 = ListItem(List=divide_36.Points, Index=number_slider_38, Wrap=True)
item_52 = ListItem(List=divide_36.Points, Index=expression_11, Wrap=True)
divide_37 = DivideCurve(Curve=polygon_7.Polygon, Count=number_slider_42, Kinks=False)  # -> Points, Tangents, Parameters
item_53 = ListItem(List=divide_37.Points, Index=number_slider_44, Wrap=True)
item_54 = ListItem(List=divide_37.Points, Index=expression_13, Wrap=True)
divide_38 = DivideCurve(Curve=polygon_8.Polygon, Count=number_slider_46, Kinks=False)  # -> Points, Tangents, Parameters
item_55 = ListItem(List=divide_38.Points, Index=number_slider_49, Wrap=True)
item_56 = ListItem(List=divide_38.Points, Index=expression_14, Wrap=True)
divide_39 = DivideCurve(Curve=polygon_9.Polygon, Count=number_slider_50, Kinks=False)  # -> Points, Tangents, Parameters
item_57 = ListItem(List=divide_39.Points, Index=number_slider_53, Wrap=True)
item_58 = ListItem(List=divide_39.Points, Index=expression_16, Wrap=True)
divide_40 = DivideCurve(Curve=polygon_10.Polygon, Count=number_slider_58, Kinks=False)  # -> Points, Tangents, Parameters
item_59 = ListItem(List=divide_40.Points, Index=number_slider_60, Wrap=True)
item_60 = ListItem(List=divide_40.Points, Index=expression_19, Wrap=True)
ln_26 = Line(StartPoint=item_51, EndPoint=item_52)
ln_27 = Line(StartPoint=item_53, EndPoint=item_54)
ln_28 = Line(StartPoint=item_55, EndPoint=item_56)

# ---- group: CENTER
avr_6 = Average(Input=divide_36.Points)

# ----
ln_29 = Line(StartPoint=divide_36.Points, EndPoint=avr_6)
item_61 = ListItem(List=ln_29, Index=number_slider_38, Wrap=True)
item_62 = ListItem(List=ln_29, Index=expression_12, Wrap=True)
ln_30 = Line(StartPoint=item_57, EndPoint=item_58)
ln_31 = Line(StartPoint=item_59, EndPoint=item_60)

# ---- group: CENTER
avr_7 = Average(Input=divide_37.Points)

# ----
ln_32 = Line(StartPoint=divide_37.Points, EndPoint=avr_7)
item_63 = ListItem(List=ln_32, Index=number_slider_44, Wrap=True)
item_64 = ListItem(List=ln_32, Index=expression_15, Wrap=True)

# ---- group: CENTER
avr_8 = Average(Input=divide_38.Points)

# ----
ln_33 = Line(StartPoint=divide_38.Points, EndPoint=avr_8)
item_65 = ListItem(List=ln_33, Index=number_slider_49, Wrap=True)
item_66 = ListItem(List=ln_33, Index=expression_17, Wrap=True)

# ---- group: CENTER
avr_9 = Average(Input=divide_39.Points)

# ----
ln_34 = Line(StartPoint=divide_39.Points, EndPoint=avr_9)
item_67 = ListItem(List=ln_34, Index=number_slider_53, Wrap=True)
item_68 = ListItem(List=ln_34, Index=expression_18, Wrap=True)

# ---- group: CENTER
avr_10 = Average(Input=divide_40.Points)

# ----
ln_35 = Line(StartPoint=divide_40.Points, EndPoint=avr_10)
item_69 = ListItem(List=ln_35, Index=number_slider_60, Wrap=True)
item_70 = ListItem(List=ln_35, Index=expression_20, Wrap=True)
divide_41 = DivideCurve(Curve=item_61, Count=Slider(0, range=0..2), Kinks=False)  # -> Points, Tangents, Parameters
divide_42 = DivideCurve(Curve=ln_26, Count=Slider(2, range=0..2), Kinks=False)  # -> Points, Tangents, Parameters
divide_43 = DivideCurve(Curve=item_62, Count=Slider(2, range=0..2), Kinks=False)  # -> Points, Tangents, Parameters
divide_44 = DivideCurve(Curve=item_63, Count=Slider(2, range=0..2), Kinks=False)  # -> Points, Tangents, Parameters
divide_45 = DivideCurve(Curve=ln_27, Count=Slider(2, range=0..2), Kinks=False)  # -> Points, Tangents, Parameters
divide_46 = DivideCurve(Curve=item_64, Count=Slider(2, range=0..2), Kinks=False)  # -> Points, Tangents, Parameters
divide_47 = DivideCurve(Curve=item_65, Count=Slider(1, range=0..2), Kinks=False)  # -> Points, Tangents, Parameters
divide_48 = DivideCurve(Curve=ln_28, Count=Slider(2, range=0..2), Kinks=False)  # -> Points, Tangents, Parameters
divide_49 = DivideCurve(Curve=item_67, Count=Slider(0, range=0..2), Kinks=False)  # -> Points, Tangents, Parameters
divide_50 = DivideCurve(Curve=ln_30, Count=Slider(2, range=0..2), Kinks=False)  # -> Points, Tangents, Parameters
divide_51 = DivideCurve(Curve=item_66, Count=Slider(2, range=0..2), Kinks=False)  # -> Points, Tangents, Parameters
divide_52 = DivideCurve(Curve=item_68, Count=Slider(2, range=0..2), Kinks=False)  # -> Points, Tangents, Parameters
divide_53 = DivideCurve(Curve=item_69, Count=Slider(2, range=0..2), Kinks=False)  # -> Points, Tangents, Parameters
divide_54 = DivideCurve(Curve=ln_31, Count=Slider(2, range=0..2), Kinks=False)  # -> Points, Tangents, Parameters
divide_55 = DivideCurve(Curve=item_70, Count=Slider(2, range=0..2), Kinks=False)  # -> Points, Tangents, Parameters
item_71 = ListItem(List=divide_41.Points, Index=number_slider_41, Wrap=True)
item_72 = ListItem(List=divide_42.Points, Index=number_slider_41, Wrap=True)
item_73 = ListItem(List=divide_43.Points, Index=number_slider_41, Wrap=True)
item_74 = ListItem(List=divide_44.Points, Index=number_slider_56, Wrap=True)
item_75 = ListItem(List=divide_45.Points, Index=number_slider_56, Wrap=True)
item_76 = ListItem(List=divide_47.Points, Index=number_slider_62, Wrap=True)
item_77 = ListItem(List=divide_48.Points, Index=number_slider_62, Wrap=True)
item_78 = ListItem(List=divide_49.Points, Index=number_slider_63, Wrap=True)
item_79 = ListItem(List=divide_46.Points, Index=number_slider_56, Wrap=True)
item_80 = ListItem(List=divide_50.Points, Index=number_slider_63, Wrap=True)
item_81 = ListItem(List=divide_51.Points, Index=number_slider_62, Wrap=True)
item_82 = ListItem(List=divide_53.Points, Index=number_slider_66, Wrap=True)
item_83 = ListItem(List=divide_52.Points, Index=number_slider_63, Wrap=True)
item_84 = ListItem(List=divide_54.Points, Index=number_slider_66, Wrap=True)
item_85 = ListItem(List=divide_55.Points, Index=number_slider_66, Wrap=True)
ln_36 = Line(StartPoint=avr_6, EndPoint=item_72)
scale_16 = Scale(Geometry=ln_36, Center=item_72, Factor=number_slider_39)  # -> Geometry, Transform
ln_37 = Line(StartPoint=avr_7, EndPoint=item_75)
ln_38 = Line(StartPoint=avr_8, EndPoint=item_77)
ln_39 = Line(StartPoint=avr_9, EndPoint=item_80)
scale_17 = Scale(Geometry=ln_37, Center=item_75, Factor=number_slider_45)  # -> Geometry, Transform
ln_40 = Line(StartPoint=avr_10, EndPoint=item_84)
scale_18 = Scale(Geometry=ln_38, Center=item_77, Factor=number_slider_51)  # -> Geometry, Transform
scale_19 = Scale(Geometry=ln_39, Center=item_80, Factor=number_slider_54)  # -> Geometry, Transform
scale_20 = Scale(Geometry=ln_40, Center=item_84, Factor=number_slider_61)  # -> Geometry, Transform
divide_56 = DivideCurve(Curve=scale_16.Geometry, Count=number_slider_39, Kinks=False)  # -> Points, Tangents, Parameters
divide_57 = DivideCurve(Curve=scale_17.Geometry, Count=number_slider_45, Kinks=False)  # -> Points, Tangents, Parameters
divide_58 = DivideCurve(Curve=scale_18.Geometry, Count=number_slider_51, Kinks=False)  # -> Points, Tangents, Parameters
divide_59 = DivideCurve(Curve=scale_19.Geometry, Count=number_slider_54, Kinks=False)  # -> Points, Tangents, Parameters
divide_60 = DivideCurve(Curve=scale_20.Geometry, Count=number_slider_61, Kinks=False)  # -> Points, Tangents, Parameters
item_86 = ListItem(List=divide_56.Points, Index=Slider(0, range=0..1), Wrap=True)
ln_41 = Line(StartPoint=item_86, EndPoint=item_71)
scale_21 = Scale(Geometry=ln_41, Center=item_71, Factor=number_slider_37)  # -> Geometry, Transform
divide_61 = DivideCurve(Curve=scale_21.Geometry, Count=number_slider_37, Kinks=False)  # -> Points, Tangents, Parameters
ln_42 = Line(StartPoint=item_86, EndPoint=item_73)
scale_22 = Scale(Geometry=ln_42, Center=item_73, Factor=number_slider_40)  # -> Geometry, Transform
divide_62 = DivideCurve(Curve=scale_22.Geometry, Count=number_slider_40, Kinks=False)  # -> Points, Tangents, Parameters
item_87 = ListItem(List=divide_62.Points, Index=Slider(0, range=0..1), Wrap=True)
item_88 = ListItem(List=divide_61.Points, Index=Slider(0, range=0..1), Wrap=True)
item_89 = ListItem(List=divide_57.Points, Index=Slider(0, range=0..1), Wrap=True)
ln_43 = Line(StartPoint=item_89, EndPoint=item_74)
scale_23 = Scale(Geometry=ln_43, Center=item_74, Factor=number_slider_43)  # -> Geometry, Transform
divide_63 = DivideCurve(Curve=scale_23.Geometry, Count=number_slider_43, Kinks=False)  # -> Points, Tangents, Parameters
ln_44 = Line(StartPoint=item_89, EndPoint=item_79)
scale_24 = Scale(Geometry=ln_44, Center=item_79, Factor=number_slider_48)  # -> Geometry, Transform
divide_64 = DivideCurve(Curve=scale_24.Geometry, Count=number_slider_48, Kinks=False)  # -> Points, Tangents, Parameters
item_90 = ListItem(List=divide_64.Points, Index=Slider(0, range=0..1), Wrap=True)
item_91 = ListItem(List=divide_58.Points, Index=Slider(0, range=0..1), Wrap=True)
ln_45 = Line(StartPoint=item_91, EndPoint=item_76)
scale_25 = Scale(Geometry=ln_45, Center=item_76, Factor=number_slider_47)  # -> Geometry, Transform
divide_65 = DivideCurve(Curve=scale_25.Geometry, Count=number_slider_47, Kinks=False)  # -> Points, Tangents, Parameters
ln_46 = Line(StartPoint=item_91, EndPoint=item_81)
scale_26 = Scale(Geometry=ln_46, Center=item_81, Factor=number_slider_55)  # -> Geometry, Transform
divide_66 = DivideCurve(Curve=scale_26.Geometry, Count=number_slider_55, Kinks=False)  # -> Points, Tangents, Parameters
item_92 = ListItem(List=divide_63.Points, Index=Slider(0, range=0..1), Wrap=True)
item_93 = ListItem(List=divide_59.Points, Index=Slider(0, range=0..1), Wrap=True)
ln_47 = Line(StartPoint=item_93, EndPoint=item_78)
scale_27 = Scale(Geometry=ln_47, Center=item_78, Factor=number_slider_52)  # -> Geometry, Transform
divide_67 = DivideCurve(Curve=scale_27.Geometry, Count=number_slider_52, Kinks=False)  # -> Points, Tangents, Parameters
ln_48 = Line(StartPoint=item_93, EndPoint=item_83)
scale_28 = Scale(Geometry=ln_48, Center=item_83, Factor=number_slider_57)  # -> Geometry, Transform
divide_68 = DivideCurve(Curve=scale_28.Geometry, Count=number_slider_57, Kinks=False)  # -> Points, Tangents, Parameters
item_94 = ListItem(List=divide_66.Points, Index=Slider(0, range=0..1), Wrap=True)
item_95 = ListItem(List=divide_65.Points, Index=Slider(0, range=0..1), Wrap=True)
item_96 = ListItem(List=divide_68.Points, Index=Slider(0, range=0..1), Wrap=True)
item_97 = ListItem(List=divide_67.Points, Index=Slider(0, range=0..1), Wrap=True)
item_98 = ListItem(List=divide_60.Points, Index=Slider(0, range=0..1), Wrap=True)
ln_49 = Line(StartPoint=item_98, EndPoint=item_82)
scale_29 = Scale(Geometry=ln_49, Center=item_82, Factor=number_slider_59)  # -> Geometry, Transform
divide_69 = DivideCurve(Curve=scale_29.Geometry, Count=number_slider_59, Kinks=False)  # -> Points, Tangents, Parameters
ln_50 = Line(StartPoint=item_98, EndPoint=item_85)
scale_30 = Scale(Geometry=ln_50, Center=item_85, Factor=number_slider_65)  # -> Geometry, Transform
divide_70 = DivideCurve(Curve=scale_30.Geometry, Count=number_slider_65, Kinks=False)  # -> Points, Tangents, Parameters
item_99 = ListItem(List=divide_70.Points, Index=Slider(0, range=0..1), Wrap=True)
item_100 = ListItem(List=divide_69.Points, Index=Slider(0, range=0..1), Wrap=True)
srf4pt_16 = _4PointSurface(CornerA=avr_6, CornerB=item_51, CornerC=item_88)
srf4pt_17 = _4PointSurface(CornerA=avr_6, CornerB=item_52, CornerC=item_87)
srf4pt_18 = _4PointSurface(CornerA=item_51, CornerB=item_52, CornerC=item_86)
srf4pt_19 = _4PointSurface(CornerA=avr_7, CornerB=item_53, CornerC=item_92)
srf4pt_20 = _4PointSurface(CornerA=avr_7, CornerB=item_54, CornerC=item_90)
srf4pt_21 = _4PointSurface(CornerA=item_53, CornerB=item_54, CornerC=item_89)
srf4pt_22 = _4PointSurface(CornerA=avr_8, CornerB=item_55, CornerC=item_95)
srf4pt_23 = _4PointSurface(CornerA=avr_9, CornerB=item_57, CornerC=item_97)
srf4pt_24 = _4PointSurface(CornerA=avr_8, CornerB=item_56, CornerC=item_94)
srf4pt_25 = _4PointSurface(CornerA=item_55, CornerB=item_56, CornerC=item_91)
srf4pt_26 = _4PointSurface(CornerA=avr_9, CornerB=item_58, CornerC=item_96)
srf4pt_27 = _4PointSurface(CornerA=item_57, CornerB=item_58, CornerC=item_93)
srf4pt_28 = _4PointSurface(CornerA=avr_10, CornerB=item_59, CornerC=item_100)
srf4pt_29 = _4PointSurface(CornerA=avr_10, CornerB=item_60, CornerC=item_99)
srf4pt_30 = _4PointSurface(CornerA=item_59, CornerB=item_60, CornerC=item_98)
random_16 = Random(Range=number_slider_64, Number=1, Seed=Slider(0, range=0..10))
Z_16 = UnitZ(Factor=random_16)
random_17 = Random(Range=number_slider_64, Number=1, Seed=Slider(4, range=0..10))
random_18 = Random(Range=number_slider_64, Number=1, Seed=Slider(6, range=0..10))
Z_17 = UnitZ(Factor=random_18)
Z_18 = UnitZ(Factor=random_17)
random_19 = Random(Range=number_slider_67, Number=1, Seed=Slider(0, range=0..10))
Z_19 = UnitZ(Factor=random_19)
random_20 = Random(Range=number_slider_67, Number=1, Seed=Slider(4, range=0..10))
random_21 = Random(Range=number_slider_67, Number=1, Seed=Slider(6, range=0..10))
random_22 = Random(Range=number_slider_68, Number=1, Seed=Slider(0, range=0..10))
Z_20 = UnitZ(Factor=random_22)
random_23 = Random(Range=number_slider_68, Number=1, Seed=Slider(4, range=0..10))
random_24 = Random(Range=number_slider_69, Number=1, Seed=Slider(0, range=0..10))
Z_21 = UnitZ(Factor=random_24)
Z_22 = UnitZ(Factor=random_21)
random_25 = Random(Range=number_slider_68, Number=1, Seed=Slider(6, range=0..10))
random_26 = Random(Range=number_slider_69, Number=1, Seed=Slider(4, range=0..10))
random_27 = Random(Range=number_slider_69, Number=1, Seed=Slider(6, range=0..10))
Z_23 = UnitZ(Factor=random_20)
Z_24 = UnitZ(Factor=random_25)
random_28 = Random(Range=number_slider_70, Number=1, Seed=Slider(0, range=0..10))
Z_25 = UnitZ(Factor=random_28)
Z_26 = UnitZ(Factor=random_27)
random_29 = Random(Range=number_slider_70, Number=1, Seed=Slider(4, range=0..10))
Z_27 = UnitZ(Factor=random_23)
random_30 = Random(Range=number_slider_70, Number=1, Seed=Slider(6, range=0..10))
Z_28 = UnitZ(Factor=random_26)
Z_29 = UnitZ(Factor=random_30)
Z_30 = UnitZ(Factor=random_29)
extr_16 = Extrude(Base=srf4pt_18, Direction=Z_17)
extr_17 = Extrude(Base=srf4pt_17, Direction=Z_16)
extr_18 = Extrude(Base=srf4pt_16, Direction=Z_18)
group_6 = Group(Objects=[extr_16, extr_17, extr_18])
extr_19 = Extrude(Base=srf4pt_21, Direction=Z_22)
extr_20 = Extrude(Base=srf4pt_20, Direction=Z_19)
extr_21 = Extrude(Base=srf4pt_19, Direction=Z_23)
group_7 = Group(Objects=[extr_19, extr_20, extr_21])
extr_22 = Extrude(Base=srf4pt_25, Direction=Z_24)
extr_23 = Extrude(Base=srf4pt_24, Direction=Z_20)
extr_24 = Extrude(Base=srf4pt_22, Direction=Z_27)
group_8 = Group(Objects=[extr_22, extr_23, extr_24])
extr_25 = Extrude(Base=srf4pt_27, Direction=Z_26)
extr_26 = Extrude(Base=srf4pt_26, Direction=Z_21)
extr_27 = Extrude(Base=srf4pt_23, Direction=Z_28)
group_9 = Group(Objects=[extr_25, extr_26, extr_27])
extr_28 = Extrude(Base=srf4pt_30, Direction=Z_29)
extr_29 = Extrude(Base=srf4pt_29, Direction=Z_25)
extr_30 = Extrude(Base=srf4pt_28, Direction=Z_30)
group_10 = Group(Objects=[extr_28, extr_29, extr_30])
