# Grasshopper definition Rose Form WSII.gh (Grasshopper 1.0.7)

number_slider = Slider(120, range=0..120)
number_slider_2 = Slider(360, range=0..360)
crv = Curve(<curve referenced from the Rhino model>)
range = Range(Domain=Slider(100, range=0..100), Steps=Slider(1, range=0..1))
Z = UnitZ(Factor=expr("x/20", number_slider_2))
X = UnitX(Factor=number_slider_2)
rad = Radians(Degrees=Slider(360, range=0..360))
sin = Sine(Value=range)
xz = XZPlane(Origin=Point(0, 0, 0))
pt = ConstructPoint(XCoordinate=sin, YCoordinate=range, ZCoordinate=0)
yz = YZPlane(Origin=Point(0, 0, 0))
xy = XYPlane(Origin=Point(0, 0, 0))
xz_2 = XZPlane(Origin=Point(0, 0, 0))
pline = PolyLine(Vertices=pt, Closed=Slider(44, range=0..100))
cyl = Cylinder(Base=PlaneXY(0, 0, 0), Radius=number_slider, Length=number_slider)
cap = CapHoles(Brep=cyl)
extr = Extrude(Base=pline, Direction=X)
extr_2 = Extrude(Base=extr, Direction=Z)
arrcurve = CurveArray(Geometry=extr_2, Curve=crv, Count=Slider(10, range=0..10))  # -> Geometry, Transform
arrpolar = PolarArray(Geometry=arrcurve.Geometry, Plane=xz, Count=Slider(9, range=0..100), Angle=rad)  # -> Geometry, Transform
rotate = Rotate(Geometry=arrpolar.Geometry, Angle=1.570796327, Plane=yz)  # -> Geometry, Transform
sdiff = SolidDifference(BrepsA=rotate.Geometry, BrepsB=cap)
