# Grasshopper definition Series_WSII_2019.gh (Grasshopper 1.0.7)
# plug-ins: Bifocals

series = Series(Start=Slider(2.5, range=0..10), Step=Slider(6, range=0..10), Count=Slider(5, range=0..10))
construct_point = ConstructPoint(XCoordinate=0, YCoordinate=0, ZCoordinate=0)
