# Grasshopper definition Sine Functions.gh (Grasshopper 1.0.7)

# Single Phase Sine Curve
number_slider = Slider(4, range=0..100)
pi = Pi(Factor=number_slider)
dom = ConstructDomain(DomainStart=0, DomainEnd=pi)
pi_2 = Pi(Factor=Slider(0, range=0..4))
range = Range(Domain=dom, Steps=Slider(128, range=0..128))
expression = Expression(A=Slider(5, range=0..10), t=range, x=pi_2, w=Slider(1, range=0..2), Expression="A*sin(w*t+x)")
pt = ConstructPoint(XCoordinate=range, YCoordinate=Slider(6, range=0..10), ZCoordinate=expression)
intcrv = Interpolate(Vertices=pt, Degree=3, Periodic=False, KnotStyle=1)  # -> Curve, Length, Domain
