# Grasshopper definition Sine Timber Plank  Vasilisa Style.gh (Grasshopper 1.0.7)

# ---- group: Plank Line
pi = Pi(Factor=Slider(20, range=0..40))
dom = ConstructDomain(DomainStart=0, DomainEnd=pi)
range = Range(Domain=dom, Steps=Slider(10, range=0..100))
pi_2 = Pi(Factor=Slider(0, range=0..4))
expression = Expression(A=Slider(3, range=0..3), y=range, x=pi_2, w=Slider(8, range=0..10), Expression="A*sin(w*y+x)")
vec = VectorXYZ(XComponent=range, YComponent=expression, ZComponent=Slider(0, range=0..10))  # -> Vector, Length

# ---- group: Crazy Plank
pline = PolyLine(Vertices=vec.Vector, Closed=False)
dom_2 = ConstructDomain(DomainStart=0, DomainEnd=Slider(10, range=0..100))
dom_3 = ConstructDomain(DomainStart=0, DomainEnd=Slider(10, range=0..100))
range_2 = Range(Domain=dom_2, Steps=Slider(1, range=0..1))
range_3 = Range(Domain=dom_3, Steps=Slider(1, range=0..1))
vec_2 = VectorXYZ(XComponent=0, YComponent=range_2, ZComponent=0)  # -> Vector, Length
vec_3 = VectorXYZ(XComponent=0, YComponent=0, ZComponent=range_3)  # -> Vector, Length
extr = Extrude(Base=pline, Direction=vec_3.Vector)
extr_2 = Extrude(Base=extr, Direction=vec_2.Vector)

# ----
# Single Phase Sine Curve
number_slider = Slider(4, range=0..100)
pi_3 = Pi(Factor=number_slider)
dom_4 = ConstructDomain(DomainStart=0, DomainEnd=pi_3)
pi_4 = Pi(Factor=Slider(0, range=0..4))
range_4 = Range(Domain=dom_4, Steps=Slider(128, range=0..128))
expression_2 = Expression(A=Slider(5, range=0..10), t=range_4, x=pi_4, w=Slider(1, range=0..2), Expression="A*sin(w*t+x)")
pt = ConstructPoint(XCoordinate=range_4, YCoordinate=Slider(6, range=0..10), ZCoordinate=expression_2)
intcrv = Interpolate(Vertices=pt, Degree=3, Periodic=False, KnotStyle=1)  # -> Curve, Length, Domain

number_slider_2 = Slider(26, range=24..50)
xy = XYPlane(Origin=Point(0, 0, 0))
series = Series(Start=Slider(24, range=0..24), Step=expr("-2", -4), Count=10)
series_2 = Series(Start=Slider(4, range=4..24), Step=4, Count=10)
box = CenterBox(Base=PlaneXY(0, 0, 0), X=expr("x-1", number_slider_2), Y=expr("x/10", number_slider_2), Z=expr("x/10", number_slider_2))
box_2 = CenterBox(Base=PlaneXY(0, 0, 0), X=expr("x", number_slider_2), Y=expr("x/10", number_slider_2), Z=expr("x/10", number_slider_2))
rotate = Rotate(Geometry=box_2, Angle=1.570796327, Plane=xy)  # -> Geometry, Transform
item = ListItem(List=series, Index=0, Wrap=True)  # -> Item, Item1, Item2, Item3, Item4, Item5, Item6, Item7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
xy_2 = XYPlane(Origin=Point(0, 0, 0))
item_2 = ListItem(List=series_2, Index=0, Wrap=True)  # -> Item, Item1, Item2, Item3, Item4, Item5, Item6, Item7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
box_3 = CenterBox(Base=PlaneXY(0, 0, 0), X=expr("x-1", number_slider_2), Y=expr("x/10", number_slider_2), Z=expr("x/10", number_slider_2))
rotate_2 = Rotate(Geometry=box_3, Angle=1.570796327, Plane=xy_2)  # -> Geometry, Transform
box_4 = CenterBox(Base=PlaneXY(0, 0, 0), X=expr("x-3", number_slider_2), Y=expr("x/10", number_slider_2), Z=expr("x/10", number_slider_2))
xy_3 = XYPlane(Origin=Point(0, 0, 0))
box_5 = CenterBox(Base=PlaneXY(0, 0, 0), X=expr("x-5", number_slider_2), Y=expr("x/10", number_slider_2), Z=expr("x/10", number_slider_2))
rotate_3 = Rotate(Geometry=box_5, Angle=1.570796327, Plane=xy_3)  # -> Geometry, Transform
box_6 = CenterBox(Base=PlaneXY(0, 0, 0), X=expr("x-7", number_slider_2), Y=expr("x/10", number_slider_2), Z=expr("x/10", number_slider_2))
X = UnitX(Factor=item.Item)
Y = UnitY(Factor=item.Item1)
X_2 = UnitX(Factor=item.Item2)
Y_2 = UnitY(Factor=item.Item3)
X_3 = UnitX(Factor=item.Item4)
Y_3 = UnitY(Factor=item.Item5)
X_4 = UnitX(Factor=item.Item6)
neg = Negative(Value=Y)
Y_4 = UnitY(Factor=item.Item7)
xy_4 = XYPlane(Origin=Point(0, 0, 0))
neg_2 = Negative(Value=X)
neg_3 = Negative(Value=X_2)
neg_4 = Negative(Value=Y_2)
neg_5 = Negative(Value=X_3)
neg_6 = Negative(Value=Y_3)
neg_7 = Negative(Value=X_4)
box_7 = CenterBox(Base=PlaneXY(0, 0, 0), X=expr("x-5", number_slider_2), Y=expr("x/10", number_slider_2), Z=expr("x/10", number_slider_2))
rotate_4 = Rotate(Geometry=box_7, Angle=1.570796327, Plane=xy_4)  # -> Geometry, Transform
neg_8 = Negative(Value=Y_4)
move = Move(Geometry=box, Motion=[neg, Y])  # -> Geometry, Transform
box_8 = CenterBox(Base=PlaneXY(0, 0, 0), X=expr("x-7", number_slider_2), Y=expr("x/10", number_slider_2), Z=expr("x/10", number_slider_2))
move_2 = Move(Geometry=rotate_3.Geometry, Motion=[neg_5, X_3])  # -> Geometry, Transform
Z = UnitZ(Factor=item_2.Item)
Z_2 = UnitZ(Factor=item_2.Item1)
Z_3 = UnitZ(Factor=item_2.Item2)
Z_4 = UnitZ(Factor=item_2.Item3)
Z_5 = UnitZ(Factor=item_2.Item4)
Z_6 = UnitZ(Factor=item_2.Item5)
move_3 = Move(Geometry=box_6, Motion=[neg_6, Y_3])  # -> Geometry, Transform
move_4 = Move(Geometry=rotate_2.Geometry, Motion=[neg_3, X_2])  # -> Geometry, Transform
move_5 = Move(Geometry=rotate_4.Geometry, Motion=[neg_7, X_4])  # -> Geometry, Transform
move_6 = Move(Geometry=box_4, Motion=[neg_4, Y_2])  # -> Geometry, Transform
move_7 = Move(Geometry=box_8, Motion=[neg_8, Y_4])  # -> Geometry, Transform
Z_7 = UnitZ(Factor=item_2.Item6)
move_8 = Move(Geometry=move.Geometry, Motion=Z)  # -> graft(Geometry), Transform
move_9 = Move(Geometry=rotate.Geometry, Motion=[neg_2, X])  # -> graft(Geometry), Transform
move_10 = Move(Geometry=move_6.Geometry, Motion=Z_3)  # -> graft(Geometry), Transform
move_11 = Move(Geometry=move_4.Geometry, Motion=Z_2)  # -> graft(Geometry), Transform
move_12 = Move(Geometry=move_2.Geometry, Motion=Z_4)  # -> graft(Geometry), Transform
move_13 = Move(Geometry=move_3.Geometry, Motion=Z_5)  # -> graft(Geometry), Transform
move_14 = Move(Geometry=move_5.Geometry, Motion=Z_6)  # -> graft(Geometry), Transform
move_15 = Move(Geometry=move_7.Geometry, Motion=Z_7)  # -> graft(Geometry), Transform
X_5 = UnitX(Factor=item.Item8)
Y_5 = UnitY(Factor=item.Item5)
neg_9 = Negative(Value=X_5)
neg_10 = Negative(Value=Y_5)
Z_8 = UnitZ(Factor=item_2.Item7)
move_16 = Move(Geometry=rotate.Geometry, Motion=[neg_9, X_5])  # -> Geometry, Transform
move_17 = Move(Geometry=box, Motion=[neg_10, Y_5])  # -> Geometry, Transform
Z_9 = UnitZ(Factor=item_2.Item8)
move_18 = Move(Geometry=move_16.Geometry, Motion=Z_8)  # -> graft(Geometry), Transform
move_19 = Move(Geometry=move_17.Geometry, Motion=Z_9)  # -> graft(Geometry), Transform
sunion = SolidUnion(Breps=[move_9.Geometry, move_8.Geometry, move_11.Geometry, move_10.Geometry, move_12.Geometry, move_13.Geometry, move_14.Geometry, move_15.Geometry, move_18.Geometry, move_19.Geometry])
