# Grasshopper definition Sine Timber Plank.gh (Grasshopper 1.0.7)

# Single Phase Sine Curve
number_slider = Slider(4, range=0..100)
pi = Pi(Factor=Slider(20, range=0..100))
pi_2 = Pi(Factor=number_slider)
dom = ConstructDomain(DomainStart=0, DomainEnd=pi_2)
dom_2 = ConstructDomain(DomainStart=0, DomainEnd=pi)
range = Range(Domain=dom_2, Steps=Slider(100, range=0..100))
pi_3 = Pi(Factor=Slider(0, range=0..4))
pi_4 = Pi(Factor=Slider(0, range=0..4))
range_2 = Range(Domain=dom, Steps=Slider(128, range=0..128))
expression = Expression(A=Slider(3, range=0..3), y=range, x=pi_3, w=Slider(1, range=0..10), Expression="A*sin(w*y+x)")
expression_2 = Expression(A=Slider(5, range=0..10), t=range_2, x=pi_4, w=Slider(1, range=0..2), Expression="A*sin(w*t+x)")
pt = ConstructPoint(XCoordinate=range_2, YCoordinate=Slider(6, range=0..10), ZCoordinate=expression_2)
vec = VectorXYZ(XComponent=range, YComponent=expression, ZComponent=Slider(6, range=0..10))  # -> Vector, Length
intcrv = Interpolate(Vertices=pt, Degree=3, Periodic=False, KnotStyle=1)  # -> Curve, Length, Domain
intcrv_2 = Interpolate(Vertices=vec.Vector, Degree=3, Periodic=False, KnotStyle=1)  # -> Curve, Length, Domain
