# Grasshopper definition Wheel Barrow WIK 002.gh (Grasshopper 1.0.7)

# Double Phase Sine Curve
number_slider = Slider(12, range=0..100)
pi = Pi(Factor=number_slider)
dom = ConstructDomain(DomainStart=0, DomainEnd=pi)
pt = ConstructPoint(XCoordinate=Slider(0.14, range=0..1), YCoordinate=Slider(0.283, range=0..1), ZCoordinate=Slider(0.001, range=0..1))
range = Range(Domain=dom, Steps=Slider(19, range=0..128))
pi_2 = Pi(Factor=Slider(1.174, range=0..4))
expression = Expression(A=Slider(3, range=0..10), t=range, x=pi_2, w=Slider(2, range=0..2), Expression="A*sin(w*t+x)")
Z = UnitZ(Factor=1)
pt_2 = ConstructPoint(XCoordinate=range, YCoordinate=0, ZCoordinate=expression)
intcrv = Interpolate(Vertices=pt_2, Degree=Slider(5, range=0..10), Periodic=False, KnotStyle=1)  # -> Curve, Length, Domain
arrpolar = PolarArray(Geometry=intcrv.Curve, Plane=PlaneXY(0, 0, 0), Count=10, Angle=6.283185307)  # -> Geometry, Transform
move = Move(Geometry=arrpolar.Geometry, Motion=Vector(0, 0, 10))  # -> Geometry, Transform
flip = FlipMatrix(Data=arrpolar.Geometry)
flip_2 = FlipMatrix(Data=move.Geometry)
loft = Loft(Curves=[flip_2, flip], Options={Adjust=False, Closed=False, LoftEnds=0, LoftSimp=0, LoftType=0, Rebuild=10, Refit=0.01})
arrlinear = LinearArray(Geometry=loft, Direction=pt, Count=10)  # -> Geometry, Transform
loft_2 = Loft(
    Curves=arrlinear.Geometry,
    Options={Adjust=False, Closed=False, LoftEnds=0, LoftSimp=0, LoftType=0, Rebuild=10, Refit=0.01})
extr = Extrude(Base=loft_2, Direction=Z)
