# Grasshopper definition Wheel Barrow WIK 003.gh (Grasshopper 1.0.7)

# Double Phase Sine Curve
number_slider = Slider(2, range=0..10)
number_slider_2 = Slider(0.977, range=0..1)
arrpolar = PolarArray(Plane=PlaneXY(0, 0, 0), Count=10, Angle=6.283185307)  # -> Geometry, Transform
pi = Pi(Factor=Slider(12, range=0..100))
move = Move(Geometry=arrpolar.Geometry, Motion=Vector(0, 0, 10))  # -> Geometry, Transform
flip = FlipMatrix(Data=arrpolar.Geometry)
dom = ConstructDomain(DomainStart=0, DomainEnd=pi)
flip_2 = FlipMatrix(Data=move.Geometry)
range = Range(Domain=dom, Steps=Slider(4, range=0..24))
pi_2 = Pi(Factor=Slider(1.531, range=0..4))
pt = ConstructPoint(XCoordinate=Slider(0, range=0..1), YCoordinate=Slider(0, range=0..1), ZCoordinate=Slider(1, range=0..1))
arrlinear = LinearArray(Geometry=[flip, flip_2], Direction=pt, Count=10)  # -> Geometry, Transform
expression = Expression(A=number_slider, t=range, x=pi_2, w=Slider(1, range=0..2), Expression="A*sin(w*t+x)")
pt_2 = ConstructPoint(XCoordinate=range, YCoordinate=0, ZCoordinate=expression)
intcrv = Interpolate(Vertices=pt_2, Degree=Slider(7, range=0..10), Periodic=False, KnotStyle=1)  # -> Curve, Length, Domain
neg = Negative(Value=number_slider_2)
construct_point = ConstructPoint(XCoordinate=Slider(10, range=0..10), YCoordinate=0, ZCoordinate=0)
geometry = Geometry(intcrv.Curve)
rotate = Rotate(Geometry=geometry, Angle=[neg, number_slider_2], Plane=PlaneXY(0, 0, 0))  # -> Geometry, Transform
scale = Scale(Geometry=geometry, Center=construct_point, Factor=Slider(1.69, range=0..2))  # -> Geometry, Transform
unit_y = UnitY(Factor=Slider(8, range=0..10))
negative = Negative(Value=unit_y)
extrude = Extrude(Base=[rotate.Geometry, scale.Geometry], Direction=unit_y)
extrude_2 = Extrude(Base=[rotate.Geometry, scale.Geometry], Direction=[unit_y, negative])
