# Grasshopper definition what i know 001.gh (Grasshopper 1.0.7)

series = Series(Start=0, Step=1, Count=10)
pt = ConstructPoint(XCoordinate=graft(series), YCoordinate=series, ZCoordinate=0)
viewer = ParamViewer(pt)
pline = PolyLine(Vertices=pt, Closed=False)
move = Move(Geometry=pline, Motion=Vector(0, 0, 10))  # -> Geometry, Transform
loft = Loft(
    Curves=[move.Geometry, pline],
    Options={Adjust=False, Closed=False, LoftEnds=0, LoftSimp=0, LoftType=0, Rebuild=10, Refit=0.01})
